# Grasshopper definition test_file.ghx (Grasshopper 1.0.8)

# ---- group: inputs
height = Slider(2322, range=1700..3000)
small_angle = Number(85.4)
# Normal model stuff
crv = Curve(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)
big_angle = Number(105)

# ----
panel = Panel(big_angle)
panel_2 = Panel(small_angle)
flip = FlipCurve(Curve=crv)  # -> Curve, Flag
rad2 = Radians(Degrees=small_angle)
rad1 = Radians(Degrees=big_angle)
line = Line(flip.Curve)
vec = Vector(line)
b1 = B2(height=height, angle=rad1)
b2 = B2(height=height, angle=rad2)
amp = Amplitude(Vector=vec, Amplitude=height)
end = EndPoints(Curve=line)  # -> Start, End
move = Move(Geometry=end.Start, Motion=amp)  # -> Geometry, Transform
xy = XYPlane(Origin=move.Geometry)
ellipse = Ellipse(Plane=xy, Radius1=b1, Radius2=b2)  # -> Ellipse, Focus1, Focus2
dam = DataDam(DataA=ellipse.Ellipse, BufferDelay=20000000, BufferMode=2)
data = Data(dam)

py3 = Python3Script(trigger=data)  # -> out, graph
# ---------- py3: Python ----------
"""Grasshopper Mirror — Topology DOT Generator (Iteration 1)

Paste this into a GhPython Script node on the Grasshopper canvas.

    Node setup
    ----------
    Input:  trigger  — connect a button or any wire to trigger generation
    Output: graph    — the topology DOT string

Target: Rhino 8+ / CPython 3.9

Output format
-------------
DOT digraph with HTML-table record nodes:
  - Input ports on the left, component name in the centre, output ports
    on the right — mirroring the visual layout of a Grasshopper node.
  - Nodes and edges are sorted by GUID so the output is byte-identical
    when nothing on the canvas has changed.
  - GUIDs serve as DOT node identifiers (invisible in rendered graphs)
    and appear in comment lines for easy grepping in text diffs.
  - No values, no positions — topology only (per the Mirror spec).
"""

import Grasshopper as gh


# ---------------------------------------------------------------------------
# Helpers
# ---------------------------------------------------------------------------

def _sanitize(name):
    """Alphanumeric + underscore only — safe for DOT port identifiers."""
    return "".join(c if c.isalnum() or c == "_" else "_" for c in name)


def _unique_port(base, seen):
    """Return *base* if unused in *seen*, otherwise append a numeric suffix."""
    candidate = base
    i = 2
    while candidate in seen:
        candidate = f"{base}{i}"
        i += 1
    seen.add(candidate)
    return candidate


def _esc(text):
    """Escape characters that are special inside HTML/DOT labels."""
    return (
        text
        .replace("&", "&amp;")
        .replace("<", "&lt;")
        .replace(">", "&gt;")
        .replace('"', "&quot;")
    )


# ---------------------------------------------------------------------------
# HTML-table label builder
# ---------------------------------------------------------------------------

def _html_label(nick, name, inputs, outputs, indent=8):
    """Build an HTML <table> label for one DOT node.

    Layout:  inputs (left) | component name (centre) | outputs (right)
    Returns a string like ``< ... >`` ready for a DOT ``label=`` attribute.
    """
    pad = " " * indent
    n_rows = max(len(inputs), len(outputs), 1)

    # Centre cell content — NickName, with (Name) on a smaller second line
    # if they differ.
    if nick and nick != name:
        centre = (
            f'{_esc(nick)}<br/>'
            f'<font point-size="10">({_esc(name)})</font>'
        )
    elif nick:
        centre = _esc(nick)
    else:
        centre = f'<font point-size="10">({_esc(name)})</font>'

    rows = []
    for i in range(n_rows):
        cells = []

        # Left column — input port
        if i < len(inputs):
            p = inputs[i]
            cells.append(f'<td port="{p["port"]}">{_esc(p["nick"])}</td>')
        else:
            cells.append("<td></td>")

        # Centre column (first row only, spanning all rows)
        if i == 0:
            cells.append(f'<td rowspan="{n_rows}">{centre}</td>')

        # Right column — output port
        if i < len(outputs):
            p = outputs[i]
            cells.append(f'<td port="{p["port"]}">{_esc(p["nick"])}</td>')
        else:
            cells.append("<td></td>")

        rows.append(f'{pad}    <tr>{"".join(cells)}</tr>')

    return (
        "<\n"
        f'{pad}<table border="0" cellborder="1" cellspacing="0" cellpadding="4">\n'
        + "\n".join(rows) + "\n"
        + f"{pad}</table>>"
    )


# ---------------------------------------------------------------------------
# Collection pass — nodes & parameter map
# ---------------------------------------------------------------------------

def _collect(gh_doc):
    """Walk the GH document and return ``(nodes, param_map)``.

    * ``nodes`` — list of node dicts, sorted by GUID.
    * ``param_map`` — ``{param_guid_str: (parent_node_guid_str, port_id)}``
      Used to resolve the source end of every connection.
    """
    objects = sorted(gh_doc.Objects, key=lambda o: str(o.InstanceGuid))

    nodes = []
    param_map = {}

    for obj in objects:
        guid = str(obj.InstanceGuid)
        nick = obj.NickName or ""
        name = obj.Name or ""

        # -- Component (incl. Clusters, Script nodes) ----------------------
        if hasattr(obj, "Params"):
            seen_ports = set()

            inputs = []
            for p in obj.Params.Input:
                pg = str(p.InstanceGuid)
                port = _unique_port(_sanitize(p.NickName) + "_in", seen_ports)
                inputs.append({"nick": p.NickName, "port": port, "guid": pg})
                param_map[pg] = (guid, port)

            outputs = []
            for p in obj.Params.Output:
                pg = str(p.InstanceGuid)
                port = _unique_port(_sanitize(p.NickName) + "_out", seen_ports)
                outputs.append({"nick": p.NickName, "port": port, "guid": pg})
                param_map[pg] = (guid, port)

            nodes.append({
                "guid": guid, "nick": nick, "name": name,
                "kind": "component",
                "inputs": inputs, "outputs": outputs, "obj": obj,
            })

        # -- Leaf / standalone parameter (slider, panel, value, …) ---------
        elif hasattr(obj, "Sources"):
            has_src = obj.Sources is not None and len(obj.Sources) > 0
            has_rec = obj.Recipients is not None and len(obj.Recipients) > 0

            inputs = []
            outputs = []
            if has_src:
                inputs.append({"nick": "in", "port": "in", "guid": guid})
            if has_rec:
                outputs.append({"nick": "out", "port": "out", "guid": guid})

            # When this leaf appears as a *source* for another node's input,
            # the SDK reports this leaf's own GUID.  Map it to the "out" port.
            if has_rec:
                param_map[guid] = (guid, "out")

            nodes.append({
                "guid": guid, "nick": nick, "name": name,
                "kind": "leaf",
                "inputs": inputs, "outputs": outputs, "obj": obj,
            })

        # -- Group / annotation / other ------------------------------------
        else:
            nodes.append({
                "guid": guid, "nick": nick, "name": name,
                "kind": "other", "obj": obj,
            })

    return nodes, param_map


# ---------------------------------------------------------------------------
# Edge collection
# ---------------------------------------------------------------------------

def _edges(nodes, param_map):
    """Return a deterministically sorted list of edges.

    Each edge is ``(src_node_guid, src_port, tgt_node_guid, tgt_port)``.
    """
    edges = []

    for node in nodes:
        guid = node["guid"]

        if node["kind"] == "component":
            # Build a quick lookup from param GUID → port id
            port_of = {inp["guid"]: inp["port"] for inp in node["inputs"]}

            for p in node["obj"].Params.Input:
                pg = str(p.InstanceGuid)
                tgt_port = port_of.get(pg)
                if tgt_port is None:
                    continue
                for src in p.Sources:
                    sg = str(src.InstanceGuid)
                    if sg in param_map:
                        sn, sp = param_map[sg]
                        edges.append((sn, sp, guid, tgt_port))

        elif node["kind"] == "leaf":
            obj = node["obj"]
            if obj.Sources:
                for src in obj.Sources:
                    sg = str(src.InstanceGuid)
                    if sg in param_map:
                        sn, sp = param_map[sg]
                        edges.append((sn, sp, guid, "in"))

    edges.sort()
    return edges


# ---------------------------------------------------------------------------
# DOT generation
# ---------------------------------------------------------------------------

def _dot(nodes, edges):
    """Assemble the final DOT string from collected nodes and edges."""
    lines = [
        "digraph G {",
        "    rankdir=LR;",
        "    node [shape=plaintext];",
        "",
        "    // --- Nodes ---",
    ]

    for n in nodes:
        if n["kind"] in ("component", "leaf"):
            label = _html_label(
                n["nick"], n["name"],
                n.get("inputs", []), n.get("outputs", []),
            )
            comment_name = n["nick"] or n["name"]
            lines.append(f'    // {comment_name} (guid: {n["guid"]})')
            lines.append(f'    "{n["guid"]}" [margin=0, label={label}];')
            lines.append("")

        elif n["kind"] == "other":
            obj_type = type(n["obj"]).__name__
            comment_name = n["nick"] or n["name"]
            lines.append(
                f'    // [skipped] {comment_name}'
                f' (type: {obj_type}, guid: {n["guid"]})'
            )

    lines.append("")
    lines.append("    // --- Edges ---")
    for sn, sp, tn, tp in edges:
        lines.append(f'    "{sn}":{sp} -> "{tn}":{tp};')

    lines.append("}")
    return "\n".join(lines)


# ---------------------------------------------------------------------------
# Entry point
# ---------------------------------------------------------------------------

def main():
    gh_doc = gh.Instances.ActiveCanvas.Document
    nodes, param_map = _collect(gh_doc)
    edges = _edges(nodes, param_map)
    return _dot(nodes, edges)


graph = main()
# ---------- end py3 ----------
dot_panel = Panel(py3.graph)

# ---- group: Canvas capture
py3_2 = Python3Script(guard=Toggle(False), trigger=data)  # -> out, a
# ---------- py3_2: Python ----------
"""Grasshopper Mirror — Canvas Screenshot

Paste this into a GhPython Script node on the Grasshopper canvas.

    Node setup
    ----------
    Input:  guard   — connect a Boolean Toggle (True = don't run)
    Output: out     — status message

Target: Rhino 8+ / CPython 3.9

Frames the full canvas extent and captures to PNG.
Computes bounds from individual object Attributes.Bounds.
Saves and restores the viewport so the view snaps back.
"""

import os
import System.Drawing as sd
import System.Windows.Forms as swf
import Grasshopper as gh


# Padding in canvas units around the computed bounds
PADDING = 60.0

# Slight inward scale so nodes aren't right at the edge
FIT_MARGIN = 0.92


def compute_objects_bounds(ghdoc):
    """Union of every object's Attributes.Bounds on the canvas."""
    first = True
    for obj in ghdoc.Objects:
        if obj.Attributes is None:
            continue
        b = obj.Attributes.Bounds
        if first:
            union = sd.RectangleF(b.X, b.Y, b.Width, b.Height)
            first = False
        else:
            union = sd.RectangleF.Union(union, b)

    if first:
        return sd.RectangleF(0, 0, 100, 100)
    return union


def save_canvas_image():
    ghdoc = ghenv.Component.OnPingDocument()
    canvas = gh.Instances.ActiveCanvas
    viewport = canvas.Viewport

    file_path = ghdoc.FilePath
    if not file_path:
        return "Cannot save: document has no file path (save the .gh first)"

    directory_path = os.path.dirname(file_path)

    # Save current viewport state so we can restore it
    saved_target = sd.Point(viewport.Target.X, viewport.Target.Y)
    saved_zoom = viewport.Zoom

    try:
        bounds = compute_objects_bounds(ghdoc)
        bounds.Inflate(PADDING, PADDING)

        # Centre of the objects region in canvas coords
        cx = bounds.X + bounds.Width / 2.0
        cy = bounds.Y + bounds.Height / 2.0

        # Zoom to fit bounds
        zoom_x = viewport.Width / bounds.Width
        zoom_y = viewport.Height / bounds.Height
        new_zoom = min(zoom_x, zoom_y) * FIT_MARGIN
        viewport.Zoom = new_zoom

        # Target is a screen pixel offset, not a canvas coordinate.
        # Projection: screen = canvas * zoom + target
        # To place canvas point (cx, cy) at screen centre:
        #   target = screen_centre - canvas_centre * zoom
        target_x = int(viewport.Width / 2 - cx * new_zoom)
        target_y = int(viewport.Height / 2 - cy * new_zoom)
        viewport.Target = sd.Point(target_x, target_y)

        viewport.ComputeProjection()
        canvas.Invalidate()
        canvas.Update()
        swf.Application.DoEvents()

        # Capture the screen buffer
        mode = gh.GUI.Canvas.GH_CanvasMode.Export
        bmp = canvas.GetCanvasScreenBuffer(mode)

        path = os.path.join(directory_path, "canvas_image.png")
        bmp.Save(path)
        bmp.Dispose()

        return f"Saved canvas image to {path}"

    finally:
        # Restore viewport immediately
        viewport.Target = saved_target
        viewport.Zoom = saved_zoom
        canvas.Refresh()


if not guard:
    a = save_canvas_image()
else:
    a = "Guarded — toggle to run"
# ---------- end py3_2 ----------
panel_3 = Panel(py3_2.a)

# ---- group: README generation
# Grasshopper Mirror stuff
panel_4 = Panel("A grasshopper version control and sharing tool")
panel_5 = Panel("https://placebear.com/300/300")
panel_6 = Panel("https://placebear.com/300/300")
detailed_description = Panel("""This file does one pretty simple thing, it puts an elipse on a line. There's a a lot of boilerplate, relatively, as the model itself is pretty simple.

This will change in the long run though, as this process is refined. The idea is that thse panels will become a different UI, and the python nodes that do the traversal and canvas screenshot will be less imposing.""")
summary = Panel("Makes a backpack for grasshopper binaries so that the backpack can be git version controlled alongside the gh binary. Also defines a pattern for documentation that goes along with it.")
origin_story = Panel("For a very long time I've wanted a better way to version control grasshopper files, and to document them, and to share them. Might as well kill three birds with one stone! I first started thinking about this [13 years ago](https://www.grasshopper3d.com/forum/topics/version-control?id=2985220%3ATopic%3A831264) and now")
panel_7 = Panel("""Ben Doherty @notionparallax
wobble @stonk
but
don't
fall
down""")
panel_8 = Panel("""weebles
wobble
but
don't
fall
down""")

# ----
py3_3 = Python3Script(
    headline=panel_4,
    tiny_description=panel_4,
    tags=panel_8,
    authors=panel_7,
    headline_image_url=panel_6,
    summary=summary,
    origin_story=origin_story,
    detailed_description=detailed_description)  # -> out, a; inputs tags: list, authors: list
# ---------- py3_3: Python ----------
"""Grasshopper Mirror — README Generator

Paste this into a GhPython Script node on the Grasshopper canvas.

    Node setup
    ----------
    Inputs (all string, from panels):
        headline, tiny_description, tags, authors,
        headline_image_url, summary, origin_story,
        detailed_description, repo_url
    Output: out — status message

Target: Rhino 8+ / CPython 3.9

Generates a README.md with YAML frontmatter in the same directory
as the .gh file.
"""

import os


def get_filename():
    ghdoc = ghenv.Component.OnPingDocument()
    return os.path.basename(ghdoc.FilePath) if ghdoc.FilePath else "unknown.gh"


def get_directory():
    ghdoc = ghenv.Component.OnPingDocument()
    if not ghdoc.FilePath:
        return None
    return os.path.dirname(ghdoc.FilePath)


def build_tag_string(tags_input):
    lines = []
    for t in tags_input:
        lines.append(f"    - {t.strip()}")
    return "\n".join(lines)


def build_author_string(authors_input):
    lines = []
    for a in authors_input:
        parts = a.split("@")
        name = parts[0].strip()
        lines.append(f"    - name: {name}")
        if len(parts) > 1:
            gh_handle = parts[1].strip()
            lines.append(f"      github: {gh_handle}")
    return "\n".join(lines)


def generate_readme():
    directory = get_directory()
    if directory is None:
        return "Cannot save: document has no file path (save the .gh first)"

    filename = get_filename()
    tag_yaml = build_tag_string(tags)
    author_yaml = build_author_string(authors)

    doc = f"""---
tiny_description: {tiny_description}
repo_url: {repo_url}
tags:
{tag_yaml}
authors:
{author_yaml}
headline_image: {headline_image_url} # fully qualified domain name, not relative.

# NOTE: this file is autogenerated from the GH component
---

# {headline} ({filename})

![An image of what this file actually does](headline_image.PNG)
![A screenshot of the grasshopper canvas](canvas_image.png)

## Summary:

_A **very** short explanation of what this does._

{summary}

## Origin story:

_Why did this file come into being?_

{origin_story}

## Detailed description:

_A much longer explanation of what this does._

{detailed_description}

"""

    path = os.path.join(directory, "README.md")
    with open(path, "w", encoding="utf-8") as f:
        f.write(doc)

    return f"Saved README to {path}"


a = generate_readme()
# ---------- end py3_3 ----------
panel_9 = Panel(py3_3.a)

# ==== cluster B2
height = ClusterInput()
angle = ClusterInput()
b = GhPythonScript(height=height, angle=angle)  # -> base
# ---------- b: Python ----------
__author__ = "bdoherty"
__version__ = "2024.06.06"

#import rhinoscriptsyntax as rs
import math

hyp = height/math.cos(angle/2)

base = math.sqrt(hyp**2 - height**2)

a = base
# ---------- end b ----------
base = ClusterOutput(b)
